# Grasshopper definition receive.gh (Grasshopper 0.9.76)
# plug-ins: Python Interpreter

python = PythonScript(setup=Toggle(False))  # -> out, a; inputs setup: Boolean
# ---------- python: Python ----------
import json
import urllib2

if setup:
    a = json.load(urllib2.urlopen('http://192.168.10.11:5000'))
# ---------- end python ----------
panel = Panel(python.a)
